# Grasshopper definition RBC.gh (Grasshopper 0.9.76)
# plug-ins: Python Interpreter

# ---- group: Load the mesh
list = ValueList({"RBC_Surface_mesh_258SurfVer": "Case Studies\RBC_Surface_mesh_258SurfVer.3dm"}, selected="RBC_Surface_mesh_258SurfVer")
_3dm = Import3DM(File=list, Layer="*", Name="*")
mesh = Mesh(_3dm)

# ---- group: Points to apply Stretching Force
percentage = Slider(0.05, range=0.01..0.3)
percentage_2 = Slider(0.05, range=0.01..0.3)
python = PythonScript(Mesh=mesh, perc_r=percentage, perc_l=percentage_2)  # -> Pt_x_plus, Pt_x_minus; inputs Mesh: Mesh
# ---------- python: Python ----------
import ghpythonlib.components as ghcomp
import Rhino as rc
import Grasshopper as gh

Pt_x_plus = []
Pt_x_minus = []

# Make mesh vertices point search list
ptsList = rc.Collections.Point3dList(Mesh.Vertices.ToPoint3dArray())

# Sort Points by x, y , z (keep the indices)
sorted_inds = ghcomp.SortPoints(ptsList)[1]

# Number of Pts to pick from each side
num_pts_r = int(perc_r*len(ptsList))
num_pts_l = int(perc_l*len(ptsList))

for i in sorted_inds[-num_pts_r:]:
    Pt_x_plus.append(ptsList[i])
for i in sorted_inds[:num_pts_l]:
    Pt_x_minus.append(ptsList[i])
# ---------- end python ----------
stretching_force_pn = Slider(200, range=0..200000)
soai = ShapeOpAnchorsIndexer(Mesh=mesh, AnchorGeo=python.Pt_x_plus)  # -> flatten(PointIndices); inputs Mesh: Mesh, AnchorGeo: list
# ---------- soai: Python ----------
"""
Gets the vertex indices of the mesh which corresponds to the points of the AnchorGeo.
If the AnchorGeo is a curve/polyline/line its start-point will be used to identify 
which mesh vertex should be anchored and its end-point will be used to determine
which point to anchor the vertex to. If the AnchorGeo is point this will be used
as both identifier and anchor point. Use curve-types to interactively manipulate
anchoring positions and points for static positions.
-
Authors: Anders Holden Deleuran (CITA/KADK), Mario Deuss (LGG/EPFL) 
Github: github.com/AndersDeleuran/ShapeOpGHPython
Updated: 150401
    Args:
        Mesh: The mesh to extract vertex indices from.
        AnchorGeo: Geometry to use for anchoring mesh vertices (points or curve-type).
    Returns:
        PointIndices: The mesh with vertices to anchor.
        AnchorPts: The anchor points.
"""

import Rhino as rc
import Grasshopper as gh

# Set component name
ghenv.Component.Name = "ShapeOpAnchorsIndexer"
ghenv.Component.NickName = "SOAI"

if AnchorGeo and Mesh and not None in AnchorGeo:
    
    # Make output datatrees
    PointIndices = gh.DataTree[int]()
    AnchorPts = gh.DataTree[rc.Geometry.Point3d]()
    
    # Make mesh vertices point search list
    ptsList = rc.Collections.Point3dList(Mesh.Vertices.ToPoint3dArray())
    
    for i,ag in enumerate(AnchorGeo):
        
        # Make datatree path
        p = gh.Kernel.Data.GH_Path(i)
        
        # Get anchor start and end points
        if isinstance(ag,rc.Geometry.Curve):
            aPtS = ag.PointAtStart
            aPtE = ag.PointAtEnd
        elif isinstance(ag,rc.Geometry.Point3d):
            aPtS = ag
            aPtE = ag
            
        # Get index of points to anchor and add to PointIndices datatree
        aPtId = ptsList.ClosestIndex(aPtS)
        PointIndices.AddRange((aPtId,),p)
        
        # Add anchor end points to datatree
        AnchorPts.Add(aPtE,p)
        
else:
    PointIndices = []
    AnchorPts = []
# ---------- end soai ----------
soai_2 = ShapeOpAnchorsIndexer(Mesh=mesh, AnchorGeo=python.Pt_x_minus)  # -> flatten(PointIndices); inputs Mesh: Mesh, AnchorGeo: list; same code as soai
neg = Negative(Value=stretching_force_pn)
X = UnitX(Factor=stretching_force_pn)
X_2 = UnitX(Factor=neg)

# ---- group: Points to apply Stretching Force / Pt Selection for Diameter Calculation
python_2 = PythonScript(Mesh=mesh)  # -> Diameter_Calc_List, x_plus, x_minus, y_plus, y_minus; inputs Mesh: Mesh
# ---------- python_2: Python ----------
import Rhino as rc
import Grasshopper as gh

ptsList = rc.Collections.Point3dList(Mesh.Vertices.ToPoint3dArray())

max_x, min_x = -100000000, 100000000
max_y, min_y = -100000000, 100000000

ind_max_x, ind_min_x = -1, -1
ind_max_y, ind_min_y = -1, -1

for i in range(len(ptsList)):
    if (ptsList[i].X >= max_x):
        max_x = ptsList[i].X
        ind_max_x = i
        x_plus = ptsList[i]
    if (ptsList[i].X <= min_x):
        min_x = ptsList[i].X
        ind_min_x = i
        x_minus = ptsList[i]
    if (ptsList[i].Y >= max_y):
        max_y = ptsList[i].Y
        ind_max_y = i
        y_plus = ptsList[i]
    if (ptsList[i].Y <= min_y):
        min_y = ptsList[i].Y
        ind_min_y = i
        y_minus = ptsList[i]

Diameter_Calc_List = [ind_max_x, ind_min_x, ind_max_y, ind_min_y]
# ---------- end python_2 ----------
pt = Point(python_2.x_plus)
pt_2 = Point(python_2.x_minus)
pt_3 = Point(python_2.y_plus)
pt_4 = Point(python_2.y_minus)

# ---- group: FEM Materials
# DISCLAIMER:
# 
# The majority of the code used here comes from the project:
# https://github.com/AndersDeleuran/ShapeOpGHPython
# 
# We heavily modified both ShapeOp (npFEM) & the Rhino-GH environment, for our needs on Computational Biophysics
list_2 = ValueList({"FaceVertices": "faceVertices", "VertexNeighbours": "vertexNeighbours", "EdgeVertices": "edgeVertices", "VerticesAll": "verticesAll", "VerticesEach": "verticesEach", "EdgeFaceVertices": "edgeFaceVertices", "FaceAngleVertices": "faceAngleVertices", "NakedVertices": "nakedVertices"}, selected="FaceVertices")
rangemin = Slider(1, range=0..1)
rangemax = Slider(1, range=1..10)
shapeopmeshindexer = ShapeOpMeshIndexer(Pattern=list_2, Volumetric_Mesh=mesh, Surface_Mesh=mesh)  # -> PointIndices, face_inds; inputs Volumetric_Mesh: Mesh, Surface_Mesh: Mesh
#   port Pattern: The vertex indices pattern to extract from the mesh: - faceVertices = vertex indices for each face. vertexNeighbours = neighbour vertex indices for each vertex. edgeVertices = vertex indices for each edge. verticesAll = vertex indices for each vertex (flat list). verticesEach = vertex indices for each vertex (datatree). edgeFaceVertices = neighbour face-vertex indices for each edge. faceAngleVertices = neighbour vertices for each vertex corner for each face. nakedVertices = vertices on the perimeter of the mesh, sorted by closed loops.
# ---------- shapeopmeshindexer: Python ----------
import Rhino as rc
import Grasshopper as gh

face_inds = []

def getFaceVertices(mesh):
    
    """ Get datatree with the face vertex indices for each face in a mesh """
    
    mesh = Surface_Mesh
    
    # Volumertic Mesh
    ptsList_V = rc.Collections.Point3dList(Volumetric_Mesh.Vertices.ToPoint3dArray())
    # Surface Mesh
    ptsList_S = rc.Collections.Point3dList(Surface_Mesh.Vertices.ToPoint3dArray())
    
    faceVertices = gh.DataTree[int]()
    
    for i in range(mesh.Faces.Count):
        fl = mesh.Faces.Item[i]
        if fl.IsQuad:
            fIDs = (fl.A,fl.B,fl.C,fl.D)
        else:
            fIDs = (fl.A,fl.B,fl.C)
        
        fIDs_updated = []
        for ind in fIDs:
            fIDs_updated.append(ptsList_V.ClosestIndex(ptsList_S[ind]))
        
        face_inds.append(fIDs_updated)
        faceVertices.AddRange(fIDs_updated,gh.Kernel.Data.GH_Path(i))
    
    return faceVertices

Mesh = None
if Pattern == "faceVertices":
    PointIndices = getFaceVertices(Mesh)
else:
    pass
# ---------- end shapeopmeshindexer ----------
pdweight = Slider(5000, range=0..1000000)
list_3 = ValueList({"Area", "SurfaceMaterial"}, selected="Area")
merge = Merge(Data1=rangemin, Data2=rangemax)
# The volumetric Mesh can be used when you have bodies discretized with tetrahedra, instead of a surface mesh only. Palabos-npFEM supports these cases and considers only the points that belong to the surface.
shapeopconstraintsignature = ShapeOpConstraintSignature(ConstraintType=list_3, PointIndices=shapeopmeshindexer.PointIndices, Weights=pdweight, Scalars=merge)  # -> ConstraintSigs; inputs PointIndices: tree of Int32, Weights: list, Scalars: tree
#   port ConstraintType: A string containing one of the following constraint types (see documentation for more info): - EdgeStrain = takes 2 indices forming an edge. TriangleStrain = takes 3 indices forming a triangle. TetrahedronStrain = takes 4 indices forming a tetrahedron. Area = takes 3 indices forming a triangle. Volume = takes 4 indices forming a tetrahedron. Bending = takes 4 indices of two neighboring triangles sharing an edge. Closeness = takes 1 index. Line = takes 2 or more indices. Plane = takes 3 or more indices. Circle = takes 3 or more indices. Sphere = takes 4 or more indices. Similarity = takes 1 or more indices. Rigid = takes 1 or more indices. Rectangle = takes 4 indices. Parallelogram = takes 4 indices. Laplacian = takes 2 or more indices, center vertex first, then the one ring neighborhood. LaplacianDisplacement = takes 2 or more indices, center vertex first, then the one ring neighborhood. AngleConstraint = takes 3 indices forming two consecutive edges.
# ---------- shapeopconstraintsignature: Python ----------
import Rhino as rc

if PointIndices.DataCount and ConstraintType and len(Weights):    
    
    # Make dict for storing shapeop constraint signature
    ConstraintSigs = {"type":ConstraintType, "pointIndices":[], "weights":[], "scalars":[]}
    
    # Convert PointIndices datatree to nested Python list and add to dict
    ConstraintSigs["pointIndices"] = [list(i) for i in PointIndices.Branches]
    
    # Add Scalars to dict if there are any
    if Scalars.DataCount:
        
        # Convert datatree to python list and ensure that length matches PointIndices
        scalars = [list(i) for i in Scalars.Branches]
        if len(scalars) != PointIndices.BranchCount:
            scalars = [list(Scalars.Branches[0]) for i in range(PointIndices.BranchCount)]
            
        # Case for point scalars datatree
        if isinstance(scalars[0][0],rc.Geometry.Point3d):
            for l in scalars:
                coords = []
                for pt in l:
                    coords.append(pt.X)
                    coords.append(pt.Y)
                    coords.append(pt.Z)
                ConstraintSigs["scalars"].append(coords)
                
        # Case for simple float datatree
        else:
            ConstraintSigs["scalars"] = scalars
            
    # Add weights to dict
    if len(Weights) != PointIndices.BranchCount:
        ConstraintSigs["weights"] = [Weights[0] for i in range(PointIndices.BranchCount)]
    else:
        ConstraintSigs["weights"] = Weights

    # Output to GH (wrap in list to send as one item)
    ConstraintSigs = [ConstraintSigs,]
    
else:
    ConstraintSigs = []
# ---------- end shapeopconstraintsignature ----------

list_4 = ValueList({"FaceVertices": "faceVertices", "VertexNeighbours": "vertexNeighbours", "EdgeVertices": "edgeVertices", "VerticesAll": "verticesAll", "VerticesEach": "verticesEach", "EdgeFaceVertices": "edgeFaceVertices", "FaceAngleVertices": "faceAngleVertices", "NakedVertices": "nakedVertices"}, selected="EdgeFaceVertices")
range_max = Slider(1, range=1..10)
range_min = Slider(1, range=0..1)
somi = ShapeOpMeshIndexer(Pattern=list_4, Volumetric_Mesh=mesh, Surface_Mesh=mesh)  # -> PointIndices; inputs Volumetric_Mesh: Mesh, Surface_Mesh: Mesh
#   port Pattern: The vertex indices pattern to extract from the mesh: - faceVertices = vertex indices for each face. vertexNeighbours = neighbour vertex indices for each vertex. edgeVertices = vertex indices for each edge. verticesAll = vertex indices for each vertex (flat list). verticesEach = vertex indices for each vertex (datatree). edgeFaceVertices = neighbour face-vertex indices for each edge. faceAngleVertices = neighbour vertices for each vertex corner for each face. nakedVertices = vertices on the perimeter of the mesh, sorted by closed loops.
# ---------- somi: Python ----------
import Rhino as rc
import Grasshopper as gh

# Set component name
ghenv.Component.Name = "ShapeOpMeshIndexer"
ghenv.Component.NickName = "SOMI"

def getEdgeFaceVertices(mesh):
    
    """ Get datatree with the four/six face vertex indices for each mesh edge, 
    which is used to construct the shapeop bending constraint signature """
    
    mesh = Surface_Mesh
    
    ptsList_V = rc.Collections.Point3dList(Volumetric_Mesh.Vertices.ToPoint3dArray())
    ptsList_S = rc.Collections.Point3dList(Surface_Mesh.Vertices.ToPoint3dArray())
    
    # Make GH datatree
    edgeFaceVerticesPtIDs = gh.DataTree[int]()
    
    for i in range(mesh.TopologyEdges.Count):
        
        p = gh.Kernel.Data.GH_Path(i)
        
        if len(mesh.TopologyEdges.GetConnectedFaces(i)) == 2:
            
            # Get edge vertex indices
            tVts = mesh.TopologyEdges.GetTopologyVertices(i)
            eVtA = mesh.TopologyVertices.MeshVertexIndices(tVts.I)[0]
            eVtB = mesh.TopologyVertices.MeshVertexIndices(tVts.J)[0]
            eVts = set((eVtA,eVtB))
            
            # Get edge face vertex index
            fA,fB = mesh.TopologyEdges.GetConnectedFaces(i)
            fVtsA = mesh.Faces.GetTopologicalVertices(fA)
            fVtsB = mesh.Faces.GetTopologicalVertices(fB)
            fVtsA = [mesh.TopologyVertices.MeshVertexIndices(i)[0] for i in fVtsA]
            fVtsB = [mesh.TopologyVertices.MeshVertexIndices(i)[0] for i in fVtsB]
            fVts = set(fVtsA + fVtsB)
            
            # Get the face indices which are not part of the edge
            fVts = list(fVts - eVts)
            
            # Make the bending constraint point indices list
            eFVIDs = list(eVts) + fVts
            
            eFVIDs_updated = []
            for ind in eFVIDs:
                eFVIDs_updated.append(ptsList_V.ClosestIndex(ptsList_S[ind]))
            
            edgeFaceVerticesPtIDs.AddRange(eFVIDs_updated,p)
            
    return edgeFaceVerticesPtIDs

Mesh = None
if Pattern == "edgeFaceVertices":
    PointIndices = getEdgeFaceVertices(Mesh)
else:
    pass
# ---------- end somi ----------
list_5 = ValueList({"Bending"}, selected="Bending")
merge_2 = Merge(Data1=range_min, Data2=range_max)
shapeopconstraintsignature_2 = ShapeOpConstraintSignature(ConstraintType=list_5, PointIndices=somi, Weights=Slider(1, range=0..100000), Scalars=merge_2)  # -> ConstraintSigs; inputs PointIndices: tree of Int32, Weights: list, Scalars: tree; same code as shapeopconstraintsignature

list_6 = ValueList({"FaceVertices": "faceVertices", "VertexNeighbours": "vertexNeighbours", "EdgeVertices": "edgeVertices", "VerticesAll": "verticesAll", "VerticesEach": "verticesEach", "EdgeFaceVertices": "edgeFaceVertices", "FaceAngleVertices": "faceAngleVertices", "NakedVertices": "nakedVertices"}, selected="FaceVertices")
miu = Slider(35, range=0..1000)
rangemin_2 = Slider(1, range=0..1)
rangemax_2 = Slider(1, range=1..10)
lambda = Slider(5, range=0..50000)
kappa = Slider(0, range=0..1000)
somi_2 = ShapeOpMeshIndexer(Pattern=list_6, Volumetric_Mesh=mesh, Surface_Mesh=mesh)  # -> PointIndices, face_inds; inputs Volumetric_Mesh: Mesh, Surface_Mesh: Mesh
#   port Pattern: The vertex indices pattern to extract from the mesh: - faceVertices = vertex indices for each face. vertexNeighbours = neighbour vertex indices for each vertex. edgeVertices = vertex indices for each edge. verticesAll = vertex indices for each vertex (flat list). verticesEach = vertex indices for each vertex (datatree). edgeFaceVertices = neighbour face-vertex indices for each edge. faceAngleVertices = neighbour vertices for each vertex corner for each face. nakedVertices = vertices on the perimeter of the mesh, sorted by closed loops.
# ---------- somi_2: Python ----------
import Rhino as rc
import Grasshopper as gh

# Set component name
ghenv.Component.Name = "ShapeOpMeshIndexer"
ghenv.Component.NickName = "SOMI"

face_inds = []

def getFaceVertices(mesh):
    
    """ Get datatree with the face vertex indices for each face in a mesh """
    
    mesh = Surface_Mesh
    
    # Volumertic Mesh
    ptsList_V = rc.Collections.Point3dList(Volumetric_Mesh.Vertices.ToPoint3dArray())
    # Surface Mesh
    ptsList_S = rc.Collections.Point3dList(Surface_Mesh.Vertices.ToPoint3dArray())
    
    faceVertices = gh.DataTree[int]()
    
    for i in range(mesh.Faces.Count):
        fl = mesh.Faces.Item[i]
        if fl.IsQuad:
            fIDs = (fl.A,fl.B,fl.C,fl.D)
        else:
            fIDs = (fl.A,fl.B,fl.C)
        
        fIDs_updated = []
        for ind in fIDs:
            fIDs_updated.append(ptsList_V.ClosestIndex(ptsList_S[ind]))
        
        face_inds.append(fIDs_updated)
        faceVertices.AddRange(fIDs_updated,gh.Kernel.Data.GH_Path(i))
    
    return faceVertices

Mesh = None
if Pattern == "faceVertices":
    PointIndices = getFaceVertices(Mesh)
else:
    pass
# ---------- end somi_2 ----------
pdweight_2 = Slider(27.5, range=0..100000)
list_7 = ValueList({"Area", "SurfaceMaterial"}, selected="SurfaceMaterial")
merge_3 = Merge(Data1=rangemin_2, Data2=rangemax_2, Data3=miu, Data4=lambda, Data5=kappa)
shapeopconstraintsignature_3 = ShapeOpConstraintSignature(ConstraintType=list_7, PointIndices=somi_2.PointIndices, Weights=pdweight_2, Scalars=merge_3)  # -> ConstraintSigs; inputs PointIndices: tree of Int32, Weights: list, Scalars: tree; same code as shapeopconstraintsignature

# ---- group: Get Mesh Vertex Positions
demesh = DeconstructMesh(Mesh=mesh)  # -> Vertices, Faces, Colours, Normals

# ----
constraintsigs = Data(flatten([shapeopconstraintsignature_2, shapeopconstraintsignature_3, shapeopconstraintsignature]))

# ---- group: Solver Settings
pause = BooleanToggle(False)
reset = BooleanToggle(True)

max_line_search_loops = Slider(15, range=0..100000)
convergence_window = Slider(5, range=2..100)
collisions_weight = Slider(15, range=0..1000000)
volumeweight = Slider(250, range=0..1000000)
cbeta = Slider(1, range=-1000..1000000)
gamma2 = Slider(0.9, range=0..1)
gamma = Slider(0.0001, range=0..1)
tol = Slider(1e-06, range=0..1)
m = Slider(15, range=2..100)
quasi_newton = BooleanToggle(True)
dynamic = BooleanToggle(True)
shapeopsettingslive = ShapeOpSettingsLive(
    max_iterations=Slider(10000, range=1..100000),
    tol=tol,
    Quasi_Newton=quasi_newton,
    gamma=gamma,
    m=m,
    max_line_search_loops=max_line_search_loops,
    gamma2=gamma2,
    Calpha=Slider(0.9, range=0..1000000),
    Cbeta=cbeta,
    TimeStep=Slider(1000, range=0..1000),
    Dynamic=dynamic,
    Pause=pause,
    Reset=reset,
    collisions_weight=collisions_weight,
    convergence_window=convergence_window,
    VolumeWeight=volumeweight)  # -> Settings; inputs max_iterations: Int32, Dynamic: Boolean, Pause: Boolean, Reset: Boolean
#   port max_iterations: The number of iterations to run each time the component updates (default = 5)
# ---------- shapeopsettingslive: Python ----------
# Wrap all settings in a dict
Settings = [{
"VolumeWeight":VolumeWeight,
"convergence_window":int(convergence_window),
"max_iterations":int(max_iterations),
"tol":tol,
"Quasi_Newton":Quasi_Newton,
"gamma":gamma,
"max_line_search_loops":int(max_line_search_loops),
"m":int(m),
"gamma2":gamma2,
"collisions_weight":collisions_weight,
"mode":"live",
"Calpha":Calpha,
"Cbeta":Cbeta,
"timeStep":TimeStep,
"dynamic":Dynamic,
"reset":Reset,
"pause":Pause
},]

print Settings
# ---------- end shapeopsettingslive ----------

# ----
steps_to_reach_steadystate = Slider(30, range=0..1500)
shapeopconstraintsolver = ShapeOpConstraintSolver(
    ConstraintSigs=constraintsigs,
    Points=demesh.Vertices,
    Settings=shapeopsettingslive,
    F_plus=X,
    F_minus=X_2,
    ind_plus_axial=soai,
    ind_minus_axial=soai_2,
    Diameter_Calc_List=python_2.Diameter_Calc_List,
    steps_to_reach_steadyState=steps_to_reach_steadystate)  # -> steps, Iterations, ConstraintCount, Points, Time, Diameter_Axial, Diameter_Transverse, Stretching_Forces; inputs ConstraintSigs: list, Points: list of Point3d, F_plus: Vector3d, F_minus: Vector3d, ind_plus_axial: list of Int32, ind_minus_axial: list of Int32, Diameter_Calc_List: list of Int32
# ---------- shapeopconstraintsolver: Python ----------
import Rhino as rc
import ctypes as ct
import Grasshopper as gh
import ghpythonlib.components as ghcomp
from scriptcontext import sticky as st

# Load the compiled stand-alone library
so = ct.cdll.LoadLibrary("npFEM.dll")

guid = str(ghenv.Component.InstanceGuid) + str(ghdoc.Path)
magnitude = "magnitude_"+guid
d_axial = "d_axial_"+guid
d_transverse = "d_transverse_"+guid
forces = "forces_"+guid
force_step = "force_step_"+guid
global_cnt = "global_cnt_"+guid
steps = "steps_"+guid

def makeSoSolver(points):
    
    """ Make ShapeOp solver and returns its ID and points coordinates ID """
    
    solver = so.shapeop_create()
    
    # Make ctypes double array containing points coordinates
    ptCoords = (ct.c_double * (len(points)*3))()
    for i in range(len(points)):
        b = 3*i
        ptCoords[b]   = float(points[i].X)
        ptCoords[b+1] = float(points[i].Y)
        ptCoords[b+2] = float(points[i].Z)
        
   # Add points coordinates to solver
    so.shapeop_setPoints(solver,ct.byref(ptCoords),len(points))
    
    return solver,ptCoords

def addSoConstraint(solver,constraintType,pointIndices,weight):
    
    """ Add a constraint: The solver is ID of shapeop solver, constraintType
    is name of constraint type to apply, pointIndices is list of points indices
    to operate on, weight is a float """
    
    t = ct.c_char_p(constraintType)
    ptIds = (ct.c_int * len(pointIndices))()
    for i,v in enumerate(pointIndices):
        ptIds[i] = v
    
    id = so.shapeop_addConstraint(solver,t,ct.byref(ptIds),len(pointIndices),weight)
    if id < 0 :
        raise LookupError("addSoConstraint failed adding a constraint of type "+constraintType)
    
    return id

def addObstacle(solver, V, N):
    
    ptCoords = (ct.c_double * (len(V)*3))()
    for i in range(len(V)):
        b = 3*i
        ptCoords[b]   = float(V[i].X)
        ptCoords[b+1] = float(V[i].Y)
        ptCoords[b+2] = float(V[i].Z)
    
    normals = (ct.c_double * (len(N)*3))()
    for i in range(len(N)):
        b = 3*i
        normals[b]   = N[i][0]
        normals[b+1] = N[i][1]
        normals[b+2] = N[i][2]
    
    so.shapeop_addObstacle(solver, ct.byref(ptCoords), ct.byref(normals), len(V));

def editSoConstraint(solver,constraintType,constraintId,scalars):
    
    """ Edit a constraint: solver is ID of shapeop solver, constraintType
    is name of constraint type to edit, constraintId is ID if the constraint.
    scalars is list of floats """
    
    t = ct.c_char_p(constraintType)
    scalarsC = (ct.c_double * len(scalars))()
    for i,s in enumerate(scalars):
        scalarsC[i] = s
        
    errCode = so.shapeop_editConstraint(solver,t,constraintId,ct.byref(scalarsC),len(scalars))
    if errCode != 0 :
        raise LookupError("editSoConstraint failed editing constraint. Check that SOGSig scalars are correctly defined.")

def addUnaryForce(solver,vector):
    
    """ Add a unary force to all points in the solver, only works dynamically """
    
    fv = (ct.c_double * 3)()
    fv[0] = float(vector.X)
    fv[1] = float(vector.Y)
    fv[2] = float(vector.Z)
    
    so.shapeop_addGravityForce(solver,fv)

def addVertexForce(solver):
    
    fv_plus = (ct.c_double * 3)()
    fv_plus[0] = float(F_plus.X/len(ind_plus_axial))
    fv_plus[1] = 0.
    fv_plus[2] = 0.
    
    fv_minus = (ct.c_double * 3)()
    fv_minus[0] = float(F_minus.X/len(ind_minus_axial))
    fv_minus[1] = 0.
    fv_minus[2] = 0.
    
    for i in ind_plus_axial:
        so.shapeop_addVertexForce(solver,fv_plus,i)
    for i in ind_minus_axial:
        so.shapeop_addVertexForce(solver,fv_minus,i)

def editVertexForce(solver, magn):
    fv_plus = (ct.c_double * 3)()
    fv_plus[0] = magn*float(1./len(ind_plus_axial))
    fv_plus[1] = 0.
    fv_plus[2] = 0.
    
    fv_minus = (ct.c_double * 3)()
    fv_minus[0] = -magn*float(1./len(ind_minus_axial))
    fv_minus[1] = 0.
    fv_minus[2] = 0.
    
    for i in range(len(ind_plus_axial)):
        so.shapeop_editVertexForce(solver, i, fv_plus, ind_plus_axial[i])
    for i in range(len(ind_minus_axial)):
        so.shapeop_editVertexForce(solver, i+len(ind_plus_axial), fv_minus, ind_minus_axial[i])

def runSoSolverLive(ghenv,constraintSigs,points,settings):
    
    """ Run the ShapeOp solver cyclically (live) and return the points """
    
    # Get GH component guid and make unique variable names for sticky keys
    guid = str(ghenv.Component.InstanceGuid) + str(ghdoc.Path)
    solver = "solver_" + guid
    ptCoords = "vCoords_" + guid
    count = "count_" + guid
    editableCS = "editableCS" + guid
    csCount = "csCount_" + guid
    time = "time_" + guid
    
    if settings["reset"]:
        
        st[time]  = 0.
        st[steps] = 0.
        
        # Delete old solver
        if solver in st:
            so.shapeop_delete(st[solver])
            
        # Make ShapeOp solver
        st[solver],st[ptCoords] = makeSoSolver(points)
        
        # Add constraints to the solver from the constraint signatures dictionary
        st[editableCS] = []
        st[csCount] = 0
        for i,csd in enumerate(constraintSigs):
            for j in range(len(csd["pointIndices"])):
                csid = addSoConstraint(st[solver],csd["type"],csd["pointIndices"][j],csd["weights"][j])
                st[csCount] += 1
                if csd["scalars"]:
                    editSoConstraint(st[solver],csd["type"],csid,csd["scalars"][j])
                    st[editableCS].append((i,j,csid))
        
        # Add obstacles
        #if obstaclesV1:
        #    addObstacle(st[solver], obstaclesV1, obstaclesF1)
        #if obstaclesV2:
        #    addObstacle(st[solver], obstaclesV2, obstaclesF2)
        
        # Add unary force
        #if settings['unaryVector']:
        #    addUnaryForce(st[solver],settings['unaryVector'])
        
        st[magnitude]    = float(F_plus.X)
        st[forces]       = [float(F_plus.X),]
        st[force_step]   = 1
        st[d_axial]      = []
        st[d_transverse] = []
        
        st[global_cnt] = 0
        if F_plus:
            addVertexForce(st[solver])
        
        # Initialize solver
        err_code = 0
        err_code = so.shapeop_initDynamic(st[solver],ct.c_double(settings["Calpha"]),ct.c_double(settings["Cbeta"]),ct.c_double(settings["timeStep"]), ct.c_double(1125), 0, 1, ct.c_double(settings["VolumeWeight"]))
        if err_code != 0 :
            raise LookupError("ShapeOp init failed. Check that each point is constrained.")
        
        # Reset count
        st[count] = 0
        
        # Set component message
        ghenv.Component.Message = None
        
    else:
        if (not settings["pause"]):
            # Solve and update the Grasshopper component (ie. update cyclically)
            err_code = so.shapeop_solve(st[solver],ct.c_int(settings["m"]),ct.c_int(settings["max_iterations"]),ct.c_int(settings["max_line_search_loops"]),ct.c_int(50), ct.c_int(settings["convergence_window"]),ct.c_double(settings["tol"]),ct.c_double(settings["gamma"]),ct.c_double(settings["gamma2"]),ct.c_double(0.5),ct.c_double(settings["collisions_weight"]))
            if err_code != 0 :
                raise LookupError("ShapeOp solve failed.")
        
        # Increment count
        st[count] += 1*settings["max_iterations"]
        st[time]  += settings["timeStep"]
        
        if (st[steps] == (steps_to_reach_steadyState-1)):
            settings["pause"] = True
        
        st[steps] += 1
        
        ghComponentTimer(ghenv,settings["pause"],10)
        
        # Set component message
        message = "Solver is Running Live"
        if settings["pause"]:
            message = "Solver is Paused"
        ghenv.Component.Message = message
        
    # Update and return the points list
    so.shapeop_getPoints(st[solver],ct.byref(st[ptCoords]),len(points))
    for i in range(len(points)):
        b = i*3
        points[i] = rc.Geometry.Point3d(st[ptCoords][b],st[ptCoords][b+1],st[ptCoords][b+2])
        
    return points,st[count],st[csCount], st[time]

def ghComponentTimer(ghenv,pause,interval):
    
    """ Update the component at the interval like using a GH timer """
    
    # Ensure interval is larger than zero
    if interval <= 0:
        interval = 1
        
    # Get the Grasshopper document and component that owns this script
    ghComp = ghenv.Component
    ghDoc = ghComp.OnPingDocument()
    
    # Define the callback function
    def callBack(ghDoc):
        ghComp.ExpireSolution(False)
        
    # Update the solution
    if not pause:
        ghDoc.ScheduleSolution(interval,gh.Kernel.GH_Document.GH_ScheduleDelegate(callBack))

# Check GH input parameters
if ConstraintSigs and Points and Settings:
    # Run solver live (i.e. the solver component will cyclically update)
    Points,Iterations,ConstraintCount, Time = runSoSolverLive(ghenv,ConstraintSigs,Points,Settings)
    
    st[d_axial].append(ghcomp.Distance(Points[Diameter_Calc_List[0]],Points[Diameter_Calc_List[1]]))
    st[d_transverse].append(ghcomp.Distance(Points[Diameter_Calc_List[2]],Points[Diameter_Calc_List[3]]))
    
    Diameter_Axial = st[d_axial]
    Diameter_Transverse = st[d_transverse]
    Stretching_Forces = st[forces]
    steps = st[steps]
# ---------- end shapeopconstraintsolver ----------

# ---- group: Output Data for Palabos-npFEM
list_8 = ValueList({"fileAddress": "DataTo_PLB_npFEM\"}, selected="fileAddress")
python_3 = PythonScript(ConstraintSigs=constraintsigs, fileAddress=list_8)  # inputs ConstraintSigs: list
# ---------- python_3: Python ----------
import Rhino as rc
import os

print fileAddress

if not os.path.exists(fileAddress):
    os.makedirs(fileAddress)

fileName = open(fileAddress+"constraints.csv", 'w')

for i,csd in enumerate(ConstraintSigs):
    for j in range(len(csd["pointIndices"])):
        string1 = str(csd["type"]) + ',' + ' '.join([str(k) for k in csd["pointIndices"][j]]) + ',' + str(csd["weights"][j])
        string2 = '\n'
        if csd["scalars"]:
            string2 = ',' + ' '.join([str(k) for k in csd["scalars"][j]]) + '\n'
        fileName.write(string1 + string2)
# ---------- end python_3 ----------
python_4 = PythonScript(points=shapeopconstraintsolver.Points, fileAddress=list_8)  # inputs points: list of Point3d
# ---------- python_4: Python ----------
import Rhino as rc
import os

print fileAddress

if not os.path.exists(fileAddress):
    os.makedirs(fileAddress)

fileName = open(fileAddress+"points.csv", 'w')
for pt in points:
    fileName.write(`pt.X` + ',' + `pt.Y` + ',' + `pt.Z` + '\n')

fileName.close()
# ---------- end python_4 ----------
python_5 = PythonScript(faces=somi_2.face_inds, fileAddress=list_8)  # inputs faces: list
# ---------- python_5: Python ----------
import Rhino as rc
import os

print fileAddress

if not os.path.exists(fileAddress):
    os.makedirs(fileAddress)

fileName = open(fileAddress+"surface_connectivity.csv", 'w')
for triangle in faces:
    fileName.write(`triangle[0]` + ',' + `triangle[1]` + ',' + `triangle[2]` + '\n')

fileName.close()
# ---------- end python_5 ----------
somi_3 = ShapeOpMeshIndexer(Volumetric_Mesh=mesh, Surface_Mesh=mesh, fileAddress=list_8)  # inputs Volumetric_Mesh: Mesh, Surface_Mesh: Mesh
# ---------- somi_3: Python ----------
import Grasshopper as gh
import Rhino as rc
import os

print fileAddress

if not os.path.exists(fileAddress):
    os.makedirs(fileAddress)

mesh = Surface_Mesh

# Volumertic Mesh
ptsList_V = rc.Collections.Point3dList(Volumetric_Mesh.Vertices.ToPoint3dArray())
# Surface Mesh
ptsList_S = rc.Collections.Point3dList(Surface_Mesh.Vertices.ToPoint3dArray())

onSurface = []
for i in range(len(ptsList_S)):
    onSurface.append(ptsList_V.ClosestIndex(ptsList_S[i]))

fileName = open(fileAddress+"onSurfaceParticle.csv", 'w')

# true == 1 & false == 0
for i in range(len(ptsList_V)):
    if (i in onSurface):
        fileName.write(`1` + '\n')
    else:
        fileName.write(`0` + '\n')

fileName.close()
# ---------- end somi_3 ----------

# ---- group: Stretching Test Curves and Volume/Area changes / Update Mesh Vertex Positions
conmesh = ConstructMesh(Vertices=shapeopconstraintsolver.Points, Faces=demesh.Faces)

# ---- group: Stretching Test Curves and Volume/Area changes
graph = QuickGraph([shapeopconstraintsolver.Diameter_Axial, shapeopconstraintsolver.Diameter_Transverse])
mesh_2 = Mesh(conmesh)
demesh_2 = DeconstructMesh(Mesh=mesh_2)  # -> Vertices, Faces, Colours, Normals

# ---- group: Stretching Test Curves and Volume/Area changes / VOLUME
volume = Volume(Geometry=mesh_2)  # -> Volume, Centroid
volume_2 = Volume(Geometry=mesh)  # -> Volume, Centroid
python_6 = PythonScript(V_f=volume.Volume, V_i=volume_2.Volume)  # -> Delta_V
# ---------- python_6: Python ----------
V_f = abs(V_f)
V_i = abs(V_i)

Delta_V = (abs(V_f-V_i)/V_i)*100
# ---------- end python_6 ----------

# ---- group: Stretching Test Curves and Volume/Area changes / Volume Change (%)
panel = Panel(python_6)

# ---- group: Stretching Test Curves and Volume/Area changes / AREA
python_7 = PythonScript(face_inds=somi_2.face_inds, Points=shapeopconstraintsolver.Points)  # -> A_f; inputs face_inds: list, Points: list of Point3d
# ---------- python_7: Python ----------
import ghpythonlib.components as ghcomp
import Rhino

A_f = 0

for lst in face_inds:
    face = Rhino.Geometry.Mesh()
    face.Vertices.Add(Points[lst[0]].X,Points[lst[0]].Y,Points[lst[0]].Z)
    face.Vertices.Add(Points[lst[1]].X,Points[lst[1]].Y,Points[lst[1]].Z)
    face.Vertices.Add(Points[lst[2]].X,Points[lst[2]].Y,Points[lst[2]].Z)
    face.Faces.AddFace(0,1,2)
    A_f += abs(ghcomp.Area(face)[0])
# ---------- end python_7 ----------
area = Area(Geometry=mesh)  # -> Area, Centroid
python_8 = PythonScript(A_f=python_7, A_i=area.Area)  # -> Delta_A
# ---------- python_8: Python ----------
A_f = abs(A_f)
A_i = abs(A_i)

Delta_A = (abs(A_f-A_i)/A_i)*100
# ---------- end python_8 ----------

# ---- group: Stretching Test Curves and Volume/Area changes / Area Change (%)
panel_2 = Panel(python_8)
